# Grasshopper definition 221229_Tributary Area.gh (Grasshopper 1.0.7)
# plug-ins: Pufferfish, Parakeet

crv = Curve(graft([<curve referenced from the Rhino model> x52]))
crv_2 = Curve([<curve referenced from the Rhino model> x22])

# ----
# Get Top of Every Column
join = JoinCurves(Curves=crv_2, Preserve=False)
simplify = SimplifyCurve(Curve=join)  # -> Curve, Simplified
end = EndPoints(Curve=simplify.Curve)  # -> Start, End
merge = Merge(Data1=graft(end.Start), Data2=graft(end.End))
pdecon = Deconstruct(Point=merge)  # -> XComponent, YComponent, ZComponent
sort = SortList(Keys=pdecon.ZComponent, ValuesA=merge)  # -> Keys, simplify(ValuesA)
item = ListItem(List=reverse(sort.ValuesA), Index=0, Wrap=True)

# ----
# Testing the Split Orientation Python
number_slider = Slider(55, range=0..100)
number_slider_2 = Slider(93, range=0..100)
number_slider_3 = Slider(13, range=0..100)
number_slider_4 = Slider(48, range=0..100)
number_slider_5 = Slider(85, range=0..100)
number_slider_6 = Slider(79, range=0..100)
pt = ConstructPoint(XCoordinate=number_slider, YCoordinate=number_slider_2, ZCoordinate=0)
pt_2 = ConstructPoint(XCoordinate=number_slider_3, YCoordinate=number_slider_4, ZCoordinate=0)
pt_3 = ConstructPoint(XCoordinate=number_slider_5, YCoordinate=number_slider_6, ZCoordinate=0)
python = GhPythonScript(
    curveStartX=number_slider,
    curveStartY=number_slider_2,
    curveEndX=number_slider_3,
    curveEndY=number_slider_4,
    x=number_slider_5,
    y=number_slider_6)  # -> out, point
# ---------- python: Python ----------
"""Provides a scripting component.
    Inputs:
        curveStartX: The curveStartX script variable
        curveStartY: The curveStartX script variable
        curveEndX: The curveEndX script variable
        curveEndY: The curveEndY script variable
        x: The x script variable
        y: The y script variable
    Output:
        point: The transformed coordinates"""

__author__ = "tlope"
__version__ = "2023.01.14"

import rhinoscriptsyntax as rs
import math
import statistics

class BE_Plane():
    def __init__(self, origin, rotationAngle = 0):
        self.origin = origin
        self.rotationAngle = rotationAngle
        self.X = origin[0]
        self.Y = origin[1]

    def transformCartesianPoint(self, pointToTransform):
        angle = getAngleBetweenLineandPlaneAxis(self.origin, pointToTransform, self, "Y")
        distance = getDistance(self.origin, pointToTransform)

        transformedX = math.cos(angle) * distance
        transformedY = math.sin(angle) * distance

        transformedCoordinates = (transformedX, transformedY)
        return transformedCoordinates     


def getPlaneFromCurve(curveStart, curveEnd):
    origin = (0,0)
    midPoint = getMidpoint(curveStart, curveEnd)
    rotationAngle = getAngleBetweenLineandPlaneAxis(midPoint, curveEnd)
    return BE_Plane(midPoint, rotationAngle)


def getAngleBetweenLineandPlaneAxis(start, end, workingPlane=BE_Plane((0,0)), axis="X"):
    assert type(start) == tuple and len(start) == 2, "Start point must be a tuple of length 2"
    assert type(end) == tuple and len(end) == 2, "End point must be a tuple of length 2"
    assert axis == "X" or axis == "Y", "Reference axis must be 'X' or 'Y'"
    
    planeAngle = workingPlane.rotationAngle
    if axis == "X":
        lineAngle = math.atan((end[0] - start[0]) / (end[1] - start[1]))
    if axis == "Y":
        lineAngle = math.atan((end[1] - start[1]) / (end[0] - start[0]))      
    return planeAngle + lineAngle


def getDistance(start, end):
    assert type(start) == tuple and len(start) == 2, "Start point must be a tuple of length 2"
    assert type(end) == tuple and len(end) == 2, "End point must be a tuple of length 2"
    distance = math.sqrt((end[0]-start[0])**2 + (end[1]-start[1])**2)
    return distance


def getMidpoint(start, end):
    assert type(start) == tuple and len(start) == 2, "Start point must be a tuple of length 2"
    assert type(end) == tuple and len(end) == 2, "End point must be a tuple of length 2"

    midX = statistics.mean([start[0], end[0]])
    midY = statistics.mean([start[1], end[1]])
    return (midX, midY)

curveStart = (curveStartX, curveStartY)
curveEnd = (curveEndX, curveEndY)

workingPlane = getPlaneFromCurve(curveStart, curveEnd)
testPoint = (x,y)

point = workingPlane.transformCartesianPoint(testPoint)
# ---------- end python ----------
ln = Line(StartPoint=pt, EndPoint=pt_2)
panel = Panel(python.point)
curvepoint = PointOnCurve(ln, parameter=0.5)
vec = Vector(ln)
Z = UnitZ(Factor=1)
xprod = CrossProduct(VectorA=vec, VectorB=Z, Unitize=True)  # -> Vector, Length
Y = UnitY(Factor=1)  # -> expr("-x", UnitVector)
ln_2 = Line(StartPoint=curvepoint, EndPoint=pt_3)
dist = Distance(PointA=curvepoint, PointB=pt_3)
pl = ConstructPlane(Origin=curvepoint, XAxis=xprod.Vector, YAxis=vec)
angle = Angle(VectorA=vec, VectorB=Y)  # -> Angle, Reflex
angle_2 = Angle(VectorA=ln_2, VectorB=Y)  # -> Angle, Reflex
cp = PlaneClosestPoint(Point=pt_3, Plane=pl)  # -> Point, UVPoint, Distance
panel_2 = Panel(angle_2.Angle)
panel_3 = Panel(angle.Angle)
subtraction = Subtraction(A=3.141592654, B=angle.Angle)
pdecon_2 = Deconstruct(Point=cp.UVPoint)  # -> XComponent, YComponent, ZComponent
panel_4 = Panel(pdecon_2.XComponent)
panel_5 = Panel(pdecon_2.YComponent)

crv_3 = Curve([<curve referenced from the Rhino model> x3])
item_2 = ListItem(List=crv_3, Index=0, Wrap=True)

# ----
# Separate 'Joists' and 'Girders'
crv_cp = CurveClosestPoint(Point=flatten(item), Curve=crv)  # -> Point, Parameter, Distance
sort_2 = SortList(Keys=crv_cp.Distance)  # -> Keys, ValuesA
item_3 = ListItem(List=sort_2.Keys, Index=0, Wrap=True)
equalst = EqualityWithinTolerance(FirstNumber=item_3, SecondNumber=0, Tolerance=0.001)
dispatch = Dispatch(List=crv, DispatchPattern=equalst)  # -> ListA, ListB
girders = Curve(flatten(dispatch.ListA))
joists = Curve(flatten(dispatch.ListB))

crv_4 = Curve(crv)
curvepoint_2 = PointOnCurve(crv_4, parameter=0.5)
crv_5 = Curve(graft(<curve referenced from the Rhino model>))
crv_6 = Curve(<curve referenced from the Rhino model>)
curvepoint_3 = PointOnCurve(crv_6, parameter=0.5)
end_2 = EndPoints(Curve=crv_5)  # -> Start, End
incurve = PointInCurve(Point=curvepoint_2, Curve=item_2)  # -> Relationship, Point
pdecon_3 = Deconstruct(Point=end_2.Start)  # -> XComponent, YComponent, ZComponent
pdecon_4 = Deconstruct(Point=end_2.End)  # -> XComponent, YComponent, ZComponent
pdecon_5 = Deconstruct(Point=curvepoint_3)  # -> XComponent, YComponent, ZComponent
all_curves = Curve(flatten(crv))
equals = Equality(FirstNumber=incurve.Relationship, SecondNumber=1)  # -> Equality, Inequality
equals_2 = Equality(FirstNumber=incurve.Relationship, SecondNumber=2)  # -> Equality, Inequality
python_2 = GhPythonScript(
    curveStartX=pdecon_3.XComponent,
    curveStartY=pdecon_3.YComponent,
    curveEndX=pdecon_4.XComponent,
    curveEndY=pdecon_4.YComponent,
    x=pdecon_5.XComponent,
    y=pdecon_5.YComponent)  # -> out, point
# ---------- python_2: Python ----------
"""Provides a scripting component.
    Inputs:
        curveStartX: The curveStartX script variable
        curveStartY: The curveStartX script variable
        curveEndX: The curveEndX script variable
        curveEndY: The curveEndY script variable
        x: The x script variable
        y: The y script variable
    Output:
        point: The transformed coordinates"""

__author__ = "tlope"
__version__ = "2023.01.14"

import rhinoscriptsyntax as rs
import math
import statistics

class BE_Plane():
    def __init__(self, origin, rotationAngle = 0):
        self.origin = origin
        self.rotationAngle = rotationAngle
        self.X = origin[0]
        self.Y = origin[1]

    def transformCartesianPoint(self, pointToTransform):
        angle = getAngleBetweenLineAndPlaneAxis(self.origin, pointToTransform, self, "Y")
        distance = getDistance(self.origin, pointToTransform)

        transformedX = math.cos(angle) * distance
        transformedY = math.sin(angle) * distance

        transformedCoordinates = (transformedX, transformedY)
        return transformedCoordinates     


class BE_PlaneFactory():
    @staticmethod
    def createPlane(origin, rotationAngle):
        return BE_Plane(origin, rotationAngle)

    @staticmethod
    def createPlaneFromCurve(curveStart, curveEnd):
        midPoint = getMidpoint(curveStart, curveEnd)
        rotationAngle = getAngleBetweenLineAndPlaneAxis(midPoint, curveEnd)
        return BE_Plane(midPoint, rotationAngle)


def getAngleBetweenLineAndPlaneAxis(start, end, workingPlane=BE_PlaneFactory.createPlane((0,0),0), axis="X"):
    assert type(start) == tuple and len(start) == 2, "Start point must be a tuple of length 2"
    assert type(end) == tuple and len(end) == 2, "End point must be a tuple of length 2"
    assert axis == "X" or axis == "Y", "Reference axis must be 'X' or 'Y'"
    
    planeAngle = workingPlane.rotationAngle
    if axis == "X":
        lineAngle = math.atan((end[0] - start[0]) / (end[1] - start[1]))
    if axis == "Y":
        lineAngle = math.atan((end[1] - start[1]) / (end[0] - start[0]))      
    return planeAngle + lineAngle


def getDistance(start, end):
    assert type(start) == tuple and len(start) == 2, "Start point must be a tuple of length 2"
    assert type(end) == tuple and len(end) == 2, "End point must be a tuple of length 2"
    distance = math.sqrt((end[0]-start[0])**2 + (end[1]-start[1])**2)
    return distance


def getMidpoint(start, end):
    assert type(start) == tuple and len(start) == 2, "Start point must be a tuple of length 2"
    assert type(end) == tuple and len(end) == 2, "End point must be a tuple of length 2"

    midX = statistics.mean([start[0], end[0]])
    midY = statistics.mean([start[1], end[1]])
    return (midX, midY)

curveStart = (curveStartX, curveStartY)
curveEnd = (curveEndX, curveEndY)

workingPlane = BE_PlaneFactory.createPlaneFromCurve(curveStart, curveEnd)
testPoint = (x,y)

point = workingPlane.transformCartesianPoint(testPoint)
# ---------- end python_2 ----------
or = GateOr(A=equals.Equality, B=equals_2.Equality)
dispatch_2 = Dispatch(List=crv_4, DispatchPattern=or)  # -> ListA, ListB
span_direction = UnitY(Factor=1)
crv_7 = Curve(dispatch_2.ListA)
id = Guid(all_curves)
angle_3 = Angle(VectorA=crv_7, VectorB=span_direction)  # -> Angle, Reflex
python_3 = GhPythonScript(x=all_curves, y=id)  # -> out, a; inputs x: list of Curve, y: list
# ---------- python_3: Python ----------
__author__ = "tlope"
__version__ = "2023.01.16"

import rhinoscriptsyntax as rs
import Rhino as rhino


class BE_Curve():
    def __init__(self, crv):
        self.crv = crv
        self.startPoint = crv.PointAtStart
        self.endPoint = crv.PointAtEnd
        
    def __str__(self):
        startPoint = str(self.startPoint)
        endPoint = str(self.endPoint)
        description = "Curve starts at point %s and ends at point %s" % (startPoint, endPoint)
        return description

class BE_StructuralCrv():
    def __init__(self, crv):
        self.crv = BE_Curve(crv)
        self.name = crv.ToString
        self.supports = []
        self.supporting = []
        self.tributaryAreas = []
        
    def __str__(self):
        curveDescription = str(self.crv) + "\n"
        curveDescription += "Curve has supports:"
        for support in self.supports:
            curveDescription += "\t" + support.name + "\n"
        curveDescription += "Curve supports:"
        for supporting in self.supporting:
            curveDescription += "\t" + supporting.name + "\n"           
        return curveDescription
        
    def get_supports(self, structuralCurves):
        for structuralCrv in structuralCurves:
            if structuralCrv != self.crv:
                intersect = rhino.Geometry.Intersect.Intersection.CurveCurve(self.crv, structuralCrv.crv, 0.001, 0.0)
                print(intersect)
                    #self.supports.append(crv)

class tributaryArea():
    def __init__(self, areaSF, locationAlongCrv, loadPSF):
        self.areaSF = areaSF
        self.locationAlongCrv = locationAlongCrv
        self.loadPSF = loadPSF

listOfStructuralCrvs = []

for structuralCrv in x:
    structuralCrv = BE_StructuralCrv(structuralCrv)
    listOfStructuralCrvs.append(structuralCrv)
    
for crv in listOfStructuralCrvs:
        crv.get_supports(listOfStructuralCrvs)
# ---------- end python_3 ----------
equalst_2 = EqualityWithinTolerance(FirstNumber=angle_3.Angle, SecondNumber=1.570796327, Tolerance=0.001)
clean = CleanTree(RemoveNulls=True, RemoveInvalid=True, RemoveEmpty=False)
panel_6 = Panel(python_3.out)
dispatch_3 = Dispatch(List=crv_7, DispatchPattern=equalst_2)  # -> ListA, ListB
clean_2 = CleanTree(RemoveNulls=True, RemoveInvalid=True, RemoveEmpty=True, Tree=dispatch_3.ListA)
crv_8 = Curve(graft(girders))

# ----
# Look to Either Side of the Beam
crv_9 = Curve(graft(crv_8))
all_curves_2 = Curve(joists)
curvepoint_4 = PointOnCurve(crv_9, parameter=0.5)
vec_2 = Vector(crv_9)
Z_2 = UnitZ(Factor=1)
curvepoint_5 = PointOnCurve(all_curves_2, parameter=0.5)
xprod_2 = CrossProduct(VectorA=vec_2, VectorB=Z_2, Unitize=True)  # -> Vector, Length
pl_2 = ConstructPlane(Origin=curvepoint_4, XAxis=xprod_2.Vector, YAxis=vec_2)
cp_2 = PlaneClosestPoint(Point=curvepoint_5, Plane=pl_2)  # -> Point, UVPoint, Distance
pdecon_6 = Deconstruct(Point=cp_2.UVPoint)  # -> XComponent, YComponent, ZComponent
larger = LargerThan(FirstNumber=pdecon_6.XComponent, SecondNumber=0)  # -> LargerThan, OrEqualTo
dispatch_4 = Dispatch(List=simplify(all_curves_2), DispatchPattern=simplify(larger.LargerThan))  # -> ListA, ListB
path_mapper = PathMapper(dispatch_4.ListA, source="{A}", target="{A;0}")
path_mapper_2 = PathMapper(dispatch_4.ListB, source="{A}", target="{A;1}")
repeat = RepeatData(Data=graft(crv_8), Length=2)  # -> simplify(graft(Data))
merge_2 = Merge(Data1=path_mapper, Data2=path_mapper_2)

# ----
# Remove Curves that Are Colinear
crv_10 = Curve(repeat)
crv_11 = Curve(merge_2)
pframe = PerpFrame(Curve=reparameterize(crv_10), Parameter=0.5)
pframe_2 = PerpFrame(Curve=reparameterize(crv_11), Parameter=0.5)
cp_3 = PlaneClosestPoint(Point=pframe_2, Plane=pframe)  # -> Point, UVPoint, Distance
equalst_3 = EqualityWithinTolerance(FirstNumber=cp_3.UVPoint, SecondNumber=0, Tolerance=0.001)
dispatch_5 = Dispatch(List=crv_11, DispatchPattern=equalst_3)  # -> ListA, ListB
crv_12 = Curve(crv_10)
crv_13 = Curve(dispatch_5.ListB)

crv_14 = Curve(crv_12)

# ----
# Remove Curves that Are Closest to Beam
crv_15 = Curve(crv_13)
# Determine whether nearby joists are parallel or perpendicular
crvprox = CurveProximity(CurveA=crv_14, CurveB=crv_15)  # -> PointA, PointB, Distance
equalst_4 = EqualityWithinTolerance(FirstNumber=crvprox.Distance, SecondNumber=0, Tolerance=0.001)
dispatch_6 = Dispatch(List=crvprox.Distance, DispatchPattern=equalst_4)  # -> ListA, ListB
dispatch_7 = Dispatch(List=crv_15, DispatchPattern=equalst_4)  # -> ListA, ListB

crv_16 = Curve()
crv_17 = Curve()

crv_18 = Curve(simplify(graft(clean_2)))
crv_19 = Curve(crv_18)

# ----
# Look to Either Side of the Beam
all_curves_3 = Curve(flatten(clean_2))
crv_20 = Curve(graft(crv_18))
curvepoint_6 = PointOnCurve(crv_20, parameter=0.5)
vec_3 = Vector(crv_20)
Z_3 = UnitZ(Factor=1)
curvepoint_7 = PointOnCurve(all_curves_3, parameter=0.5)
xprod_3 = CrossProduct(VectorA=vec_3, VectorB=Z_3, Unitize=True)  # -> Vector, Length
pl_3 = ConstructPlane(Origin=curvepoint_6, XAxis=xprod_3.Vector, YAxis=vec_3)
cp_4 = PlaneClosestPoint(Point=curvepoint_7, Plane=pl_3)  # -> Point, UVPoint, Distance
pdecon_7 = Deconstruct(Point=cp_4.UVPoint)  # -> XComponent, YComponent, ZComponent
larger_2 = LargerThan(FirstNumber=pdecon_7.XComponent, SecondNumber=0)  # -> LargerThan, OrEqualTo
dispatch_8 = Dispatch(List=simplify(all_curves_3), DispatchPattern=simplify(larger_2.LargerThan))  # -> ListA, ListB
path_mapper_3 = PathMapper(dispatch_8.ListA, source="{A}", target="{A;0}")
path_mapper_4 = PathMapper(dispatch_8.ListB, source="{A}", target="{A;1}")
repeat_2 = RepeatData(Data=graft(crv_18), Length=2)  # -> simplify(graft(Data))
merge_3 = Merge(Data1=path_mapper_3, Data2=path_mapper_4)

# ----
# Remove Curves that Are Colinear
crv_21 = Curve(repeat_2)
crv_22 = Curve(merge_3)
pframe_3 = PerpFrame(Curve=reparameterize(crv_21), Parameter=0.5)
pframe_4 = PerpFrame(Curve=reparameterize(crv_22), Parameter=0.5)
cp_5 = PlaneClosestPoint(Point=pframe_4, Plane=pframe_3)  # -> Point, UVPoint, Distance
equalst_5 = EqualityWithinTolerance(FirstNumber=cp_5.UVPoint, SecondNumber=0, Tolerance=0.001)
dispatch_9 = Dispatch(List=crv_22, DispatchPattern=equalst_5)  # -> ListA, ListB
crv_23 = Curve(dispatch_9.ListB)

crv_24 = Curve(repeat_2)

# ----
# Remove Curves that Are Closest to Beam
cluster = Cluster(tree_to_match=crv_23, tree_to_clean=crv_24)  # -> clean_match_tree, clean_tree
crv_25 = Curve(cluster.clean_tree)
crvprox_2 = CurveProximity(CurveA=crv_25, CurveB=cluster.clean_match_tree)  # -> PointA, PointB, Distance
equalst_6 = EqualityWithinTolerance(FirstNumber=crvprox_2.Distance, SecondNumber=0, Tolerance=0.001)
dispatch_10 = Dispatch(List=cluster.clean_match_tree, DispatchPattern=equalst_6)  # -> ListA, ListB
dispatch_11 = Dispatch(List=crvprox_2.Distance, DispatchPattern=equalst_6)  # -> ListA, ListB

# ----
# Remove Curves that Perpendicular to Beam
vec_4 = Vector(dispatch_10.ListB)
vec_5 = Vector(cluster.clean_tree)
angle_4 = Angle(VectorA=vec_5, VectorB=vec_4)  # -> Angle, Reflex
roundf = RoundToFactor(NumberX=angle_4.Angle, Factor=1.570796327, RoundType=0)  # -> Rounded, Difference, MultiplierR, MultiplierX
division = Division(A=roundf.Rounded, B=1.570796327)
mod = Modulus(A=division, B=2)
dispatch_12 = Dispatch(List=dispatch_10.ListB, DispatchPattern=mod)  # -> ListA, ListB
dispatch_13 = Dispatch(List=dispatch_11.ListB, DispatchPattern=mod)  # -> ListA, ListB

curvepoint_8 = PointOnCurve(dispatch_12.ListB, parameter=0.5)

# ----
# Find closest distance of neighboring curves,
# get all curves that are that distance away.
cset = CreateSet(List=dispatch_13.ListB)  # -> Set, Map
sort_3 = SortList(Keys=cset.Set)  # -> Keys, ValuesA
item_4 = ListItem(List=sort_3.Keys, Index=0, Wrap=True)
mindex = MemberIndex(Set=dispatch_13.ListB, Member=item_4)  # -> Index, Count
item_5 = ListItem(List=dispatch_12.ListB, Index=mindex.Index, Wrap=True)  # -> simplify(Item)

# ----
# Compare Adjacency. Logic Needs Work
crv_26 = Curve(reparameterize(cluster.clean_tree))
end_3 = EndPoints(Curve=crv_26)  # -> Start, End

curvepoint_9 = PointOnCurve(crv_26, parameter=0.5)
dist_2 = Distance(PointA=curvepoint_8, PointB=curvepoint_9)
sort_4 = SortList(Keys=dist_2, ValuesA=dispatch_12.ListB)  # -> Keys, ValuesA
item_6 = ListItem(List=sort_4.ValuesA, Index=0, Wrap=True)

aligncrv = AlignCurves(Curves=item_6, Guide=crv_26)
end_4 = EndPoints(Curve=aligncrv)  # -> Start, End
tweencrv = TweenCurve(CurveA=crv_26, CurveB=aligncrv, Factor=0.5, BlendType=0)

pt_4 = Point(end_3.Start)
pt_5 = Point(end_4.Start)

loft = Loft(
    Curves=[crv_26, tweencrv],
    Options={Adjust=False, Closed=False, LoftEnds=0, LoftSimp=0, LoftType=0, Rebuild=10, Refit=0.01})  # -> simplify(Loft)
trim = TrimTree(Tree=loft, Depth=1)
join_2 = BrepJoin(Breps=trim)  # -> Breps, Closed
fmerge = MergeFaces(Brep=join_2.Breps)  # -> simplify(Breps), Before, After

srf = Surface(fmerge.Breps)

# ==== cluster Cluster
tree_to_match = ClusterInput()
tree_to_clean = ClusterInput()
clean = CleanTree(RemoveNulls=True, RemoveInvalid=True, RemoveEmpty=True, TreeToMatch=tree_to_match)
tstat = TreeStatistics(Tree=clean)  # -> Paths, Length, Count
branch = TreeBranch(TreeToClean=tree_to_clean, Path=tstat.Paths, MaintainPaths=True)
clean_tree = ClusterOutput(branch)
clean_match_tree = ClusterOutput(clean)
